# Dynamo graph Topologic to BIM.dyn "Topologic to Revit 18" (Dynamo 2.10.1.3976)

# group: Inputs
exterior_wall_type = WallTypes("Exterior - Brick on Mtl. Stud")  # graph input
building_envelope = Filename("..\00_Models\00_Export\18.1.sat")  # graph input
splitting_faces = Filename("..\00_Models\00_Export\18.2.sat")  # graph input
apertures = Filename("..\00_Models\00_Export\18.3.sat")  # graph input
metric_generic_model_file_path = Filename("..\..\..\..\..\..\..\..\..\..\..\ProgramData\Autodesk\RVT 2022\Family Templates\English\Metric Generic Model.rft")  # graph input
interior_wall_type = WallTypes("Interior - 138mm Partition (1-hr)")  # graph input
floor_type = FloorTypes("Concrete-Domestic 425mm")  # graph input
door_family_type = FamilyTypes("M_Single-Flush:0915 x 2134mm")  # graph input
window_family_type = FamilyTypes("M_Window-Casement-Double:1400 x 1800mm")  # graph input

code_block = CodeBlock(external_cell=building_envelope, interior_faces=splitting_faces, apertures=apertures) { external_cell; interior_faces; apertures; }

# group: Cell Complex Creation
create_cell_complex_and_extract = Python(IN[0]=code_block.external_cell, IN[1]=code_block.interior_faces, IN[2]=code_block.apertures)  # "Create Cell Complex and extract elevations"; CPython3
# ---------- create_cell_complex_and_extract.python (235 lines) ----------
#This finds all of the levels in the model
import sys
import clr
clr.AddReference('ProtoGeometry')
clr.AddReference('TopologicDynamo')
from Autodesk.DesignScript.Geometry import *
from System.Collections.Generic import Dictionary
from System import String
from System import Object
import Topologic
import Topologic.Utilities as TU
import itertools
import math


###########################################################################################
"""This first section creates the functions to be used in the script, divided by use"""
###########################################################################################


#1 : Creation of Cell Complex
###########################################################################################
def transform_to_topologic(geometry):
  """Takes a geometry and converts it into a Topologic element """
  geometry = [Topologic.Topology.ByGeometry(g,0.001) for g in geometry]
  return geometry
        
def create_cell_complex(external,interior):
  """Creates a cell complex from external cell, interior faces and apertures"""
  external = list(itertools.chain(*[topology.Cells for topology in external]))
  interior = list(itertools.chain(*[topology.Faces for topology in interior]))
  cluster = Topologic.Cluster.ByTopologies(interior)
  cell_complex = external[0].Slice(cluster,True)
  return cell_complex

def find_elevations (cell_complex):
  """Finds and returns all of the elevations in the cell_complex"""
  elevations = []
  cells = [cell_complex.Cells]
  cells = list(itertools.chain(*cells))
  for cell in cells:
    faces = cell.Faces
    for face in faces:
        elevation1 = round((TU.FaceUtility.VertexAtParameters(face,0,0)).Z,3)+0.0
        elevation2 = round((TU.FaceUtility.VertexAtParameters(face,1,1)).Z,3)+0.0
        if elevation1 not in elevations:
            elevations.append(elevation1)
        if elevation2 not in elevations:
            elevations.append(elevation2)
  elevations.sort()
  return elevations


def find_level(cell):
  """Finds the corresponding level to the cell"""
  elevations = []
  vertices = cell.Vertices
  for vertex in vertices:
    elevation = round(vertex.Z,3)
    if elevation not in elevations:
      elevations.append(elevation)
  output = [min(elevations), max(elevations)]
  return output

def assign_dictionaries(cell_complex):
  """Assigns dictionaries for Level and Number for each cell of the cell_complex"""
  dictionaries = []
  internal_vertices = []
  cells = cell_complex.Cells
  for number in range(len(cells)):
    cell = cells[number]
    level = find_level(cell)[0]
    d = dict()
    keys = ["Level","Number","Name","Finish"]
    values = [level, number,"",""]
    internal_vertex = TU.CellUtility.InternalVertex(cell,0.01)
    for key,value in zip(keys,values):
      d[key] = str(value)
    dictionaries.append(d)
    internal_vertices.append(internal_vertex)
  cell_complex = cell_complex.SetDictionaries(internal_vertices,dictionaries,32)
  return cell_complex


#2 : Create and add information to apertures
###########################################################################################
def find_insertion_point(aperture):
  """Finds the insertion point for each type of aperture"""
  edges = aperture.Edges
  z_values = []
  horizontal = []
  for edge in edges:
    if abs(edge.StartVertex.Z - edge.EndVertex.Z) < 0.001:
      z_values.append(edge.StartVertex.Z)
      horizontal.append(edge)
  min_value = min(z_values)
  min_index = z_values.index(min_value)
  min_edge = horizontal[min_index]
  min_edge = min_edge.Geometry
  point = min_edge.PointAtParameter(0.5)
  point = Topologic.Topology.ByGeometry(point,0.001)
  return point
    
def find_type(vertices,elevations):
  """Checks if the aperture is a window or a door"""
  for v in vertices:
    if round(v.Z,3) in elevations:
      return True
  return False
        
def find_dimensions(apertures, elevations):
  """Checks the dimensions of the aperture"""
  for number in range(len(apertures)):
    aperture = apertures[number]
    point = find_insertion_point(aperture)
    edges = aperture.Edges
    vertices = aperture.Vertices
    area = TU.FaceUtility.Area(aperture)
    for e in range(len(edges)):
      edge = edges[e]
      if abs(edge.StartVertex.Z - edge.EndVertex.Z) < 0.001:
        width = round(TU.VertexUtility.Distance(edge.StartVertex,edge.EndVertex),3)
    height = round((area/width),3)
    type = 'Door' if find_type(vertices,elevations) else 'Window'
    dictionary = {'Height' : str(height), 'Width' : str(width) , 'Number' : str(number) , 'Opening' : str(type) , 'Type Name' : str(str(width)+' x '+str(height)+' m')}
    aperture = aperture.AddContent(point,8)
    aperture = aperture.SetDictionary(dictionary)
    apertures[number] = aperture
  return apertures

#3 : Curved or slanted walls
###########################################################################################
def find_slanted_faces(normal):
  """Checks if a face is slanged"""
  if 0.001< abs(normal[0]) <0.999 or 0.001< abs(normal[1]) <0.999 or 0.001< abs(normal[2]) <0.999:
    return True


# Mass creation for curved cells
def find_curved_cell(cell):
    """This function searched a cell that has a curved face"""
    parameters = [[0,0.5],[0,1],[0.5,0],[0.5,0.5],[0.5,1],[1,0],[1,0.5],[1,1]]
    faces = cell.Faces
    for face in faces:
        normals = []
        n = TU.FaceUtility.NormalAtParameters(face,0,0)
        n = [round(n[0],3)+0.0,round(n[1],3)+0.0,round(n[2],3)+0.0]
        if find_slanted_faces(n):
          return cell.Geometry
        normals.append(str(n))
        for p in range(len(parameters)):
            normal = TU.FaceUtility.NormalAtParameters(face, parameters[p][0],parameters[p][1])
            normal = [round(normal[0],3)+0.0,round(normal[1],3)+0.0,round(normal[2],3)+0.0]
            if str(normal) not in normals:
              return cell.Geometry

def insertion_point(cells):
  """This function searches for the insertion point of a mass for the Mass family inside of Revit"""
  points = []
  for cell in cells:
    if isinstance(cell,Solid):
        bounding_box = cell.BoundingBox
        point = bounding_box.MinPoint
        points.append(point)
  return points

def name_of_masses(cells):
    """This function creates the names for the masses to be created"""
    names = []
    for m in range(len(cells)):
        name = 'Mass ' + str(m)
        names.append(name)
    return names

#Finds faces that represent walls and floors
def find_horizontal(face):
  """Finds horizontal faces, but can contain slope"""
  normal = TU.FaceUtility.NormalAtParameters(face,0.5,0.5)
  if -0.45<= normal[2] <= 0.45:
    return True


def round_normal(normal):
    """This function takes a normal and rounds each direction to the nearest 0.001"""
    x = round(normal[0],3)+0.0
    y = round(normal[1],3)+0.0
    z = round(normal[2],3)+0.0
    normal = [x,y,z]
    return normal

def find_curved_face(face):
        """This function searched for a face with different normals"""
        parameters = [[0.25,0.75],[0.5,0.25],[0.5,0.5],[0.5,0.75],[0.75,0.25],[0.75,0.5],[0.75,0.75]]
        normals = []
        normal = str(round_normal(TU.FaceUtility.NormalAtParameters(face,0.25,0.25)))
        normals.append(normal)
        print(normals)
        for p in range(len(parameters)):
                normal = TU.FaceUtility.NormalAtParameters(face, parameters[p][0],parameters[p][1])
                normal = str(round_normal(normal))
                print(normal)
                if normal not in normals:
                        return False
        return True


external = Geometry.ImportFromSAT(IN[0])
interior = Geometry.ImportFromSAT(IN[1])
apertures = Geometry.ImportFromSAT(IN[2])

#Transform the input geometry into Topologic
external = transform_to_topologic(external)
interior = transform_to_topologic(interior)
apertures = transform_to_topologic(apertures)


#Create cell_complex with the imported geometry and assign dictionaries
cell_complex = create_cell_complex(external,interior)
cell_complex = assign_dictionaries(cell_complex)


#Find elevations of the model to create levels
elevations = find_elevations(cell_complex)

#Apertures
apertures = find_dimensions(apertures, elevations)
cell_complex = cell_complex.AddApertures(apertures)

#find cells that are curved to convert to masses
curved_cells  = list(filter(None,[find_curved_cell(cell) for cell in cell_complex.Cells]))
insertion_points = insertion_point(curved_cells)
names_masses = name_of_masses(curved_cells)


OUT = cell_complex , elevations , curved_cells , apertures , insertion_points , names_masses
# ----------------------------------------
code_block_2 = CodeBlock(output=create_cell_complex_and_extract)
# ---------- code_block_2.designscript (6 lines) ----------
curvedCells = output[2];
elevations = output[1];
cellComplex = output[0];
apertures = output[3];
insertion_points = output[4];
names_masses = output[5];
# ----------------------------------------

get_walls_and_floors = Python(IN[0]=code_block_2.cellComplex, IN[1]=code_block_2.elevations)  # CPython3
# ---------- get_walls_and_floors.python (143 lines) ----------
import sys
import clr
clr.AddReference('ProtoGeometry')
clr.AddReference('TopologicDynamo')
from Autodesk.DesignScript.Geometry import *
import Topologic
import Topologic.Utilities as TU
from itertools import chain


def find_horizontal(face):
        """ This function searches for horizontal faces, but can have an incline"""
        normal = TU.FaceUtility.NormalAtParameters(face,0.5,0.5)
        if -0.45<= normal[2] <= 0.45:
                return True
def round_normal(normal):
    """This function rounds the normals to the nearest 0.001"""
    x = round(normal[0],3)+0.0
    y = round(normal[1],3)+0.0
    z = round(normal[2],3)+0.0
    normal = [x,y,z]
    return normal
def find_curved_face(face):
        parameters = [[0.25,0.75],[0.5,0.25],[0.5,0.5],[0.5,0.75],[0.75,0.25],[0.75,0.5],[0.75,0.75]]
        normals = []
        normal = str(round_normal(TU.FaceUtility.NormalAtParameters(face,0.25,0.25)))
        normals.append(normal)
        print(normals)
        for p in range(len(parameters)):
                normal = TU.FaceUtility.NormalAtParameters(face, parameters[p][0],parameters[p][1])
                normal = str(round_normal(normal))
                if normal not in normals:
                        return False
        return True

def find_walls_floors(faces):
        """This function divides the faces between walls and floors"""
        walls = []
        floors = []
        for face in range(len(faces)):
                if find_horizontal(faces[face]):
                        if find_curved_face(faces[face]):
                            walls.append(faces[face])
                else:
                        floors.append(faces[face])
        return walls,floors

def find_height_wall(faces):
    """This function searches for the height of the walls"""
    for face in range(len(faces)):
        area = TU.FaceUtility.Area(faces[face])
        edges = faces[face].Edges
        for edge in edges:
            if abs(edge.StartVertex.Z - edge.EndVertex.Z)<0.01:
                length = TU.VertexUtility.Distance(edge.StartVertex , edge.EndVertex)
        height = round(area/length,3)
        dictionary = {'Height': str(height)}
        faces[face] = faces[face].SetDictionary(dictionary)
    return faces

def create_levels_dict(elevations):
    """This function creates a dictionary for each level"""
    levels_dict = dict()
    for e in elevations:
        levels_dict['Level '+ str(e)] = []
    return levels_dict

def walls_to_levels(walls,levels_dict):
    """This funcation takes faces and organizes them by level"""
    for wall in range(len(walls)):
        height = walls[wall].Dictionary['Height']
        edges = walls[wall].Edges
        normal = TU.FaceUtility.NormalAtParameters(walls[wall],0.5,0.5)
        normal = round_normal(normal)
        edge_len = len(edges)
        vertices = walls[wall].Vertices
        z_values = [v.Z for v in vertices]
        z = min(z_values)
        if normal[2] == float(0):
            if edge_len >4:
                elevation = round(z,3) + 0.0
                levels_dict['Level ' + str(elevation)].append([e.Geometry for e in edges])
            else:
                for e in range(len(edges)):
                    edge = edges[e]
                    #The conditional checks that only the bottom horizontal edge of the face is added to the dictionary
                    if abs(edge.StartVertex.Z - edge.EndVertex.Z)<0.01 and abs(edge.StartVertex.Z - z)<0.01:
                        elevation = round(edge.StartVertex.Z,3) + 0.0
                        levels_dict['Level ' + str(elevation)].append([edges[e].Geometry,height])
        else:
            elevation = round(z,3) + 0.0
            normal = Point.ByCoordinates(normal[0],normal[1],normal[2]).AsVector()
            levels_dict['Level ' + str(elevation)].append([[e.Geometry for e in edges],normal])         
    return levels_dict

def floors_to_dict(levels_dict_floors,floors):
    """This funcion separates floor to corresponding level"""
    for floor in range(len(floors)):
        elevation = TU.FaceUtility.VertexAtParameters(floors[floor],0,0)
        try:
            levels_dict_floors['Level ' + str(round(elevation.Z,3)+0.0)].append(floors[floor])
        except KeyError:
            print('Key Error')
    for key,value in list(levels_dict_floors.items()):
        surfaces = []
        for item in value:
                surface = item.Geometry
                surfaces.append(surface)
        if len(surfaces) > 0:
            surface = PolySurface.ByJoinedSurfaces(surfaces)
            curves = surface.PerimeterCurves()
            levels_dict_floors[key] = curves
    return levels_dict_floors

cell_complex = IN[0]
elevations  = IN[1]
external = cell_complex.ExternalBoundary
internal = cell_complex.InternalBoundaries
external = external.Faces

#With all of the faces of the interior and exterior boundaries, the faces will be filtered and catalogues by interior and exterior walls and floors    
external_walls = find_walls_floors(external)[0]
internal_walls = find_walls_floors(internal)[0]
floors = find_walls_floors(internal)[1] + find_walls_floors(external)[1]

#This will add the height to each curve as a dictionary value.
external_walls = find_height_wall(external_walls)
internal_walls = find_height_wall(internal_walls)

#Create all of the dictionaries that will host the wall curve and the height. 
#There will be two dictionaries: one for interior walls and another for exterior walls
levels_dict_int= create_levels_dict(elevations)
levels_dict_ext = create_levels_dict(elevations)
levels_dict_floors = create_levels_dict(elevations)

#After creating the empty dictionaries, the walls geometry and dictionaries will be added.
levels_dict_int = walls_to_levels(internal_walls,levels_dict_int)
levels_dict_ext = walls_to_levels(external_walls,levels_dict_ext)

#Add floor geometry to the dictionary
levels_dict_floors = floors_to_dict(levels_dict_floors,floors)

OUT = levels_dict_int , levels_dict_ext, levels_dict_floors
# ----------------------------------------
get_and_create_levels = Python(IN[0]=code_block_2.elevations)  # CPython3
# ---------- get_and_create_levels.python (71 lines) ----------
# Load the Python Standard and DesignScript Libraries
import sys
import clr
clr.AddReference('ProtoGeometry')
from Autodesk.DesignScript.Geometry import *
clr.AddReference('RevitServices')
import RevitServices
from RevitServices.Persistence import DocumentManager
from RevitServices.Transactions import TransactionManager
clr.AddReference('RevitAPI')
from Autodesk.Revit.DB import *
clr.AddReference ('RevitNodes')
import Revit
clr.ImportExtensions(Revit.Elements)
clr.ImportExtensions(Revit.GeometryConversion)

doc = DocumentManager.Instance.CurrentDBDocument


#Insert elevations from the model
elevations = IN[0]
elevations.sort()

#Get the levels from the model and convert them to Dynamo elements
collector = FilteredElementCollector(doc)
levels = collector.OfCategory(BuiltInCategory.OST_Levels).ToElements()
levels = levels[1:]

TransactionManager.Instance.EnsureInTransaction(doc)

for l in range(len(levels)):
        e = elevations[l]
        e_name = str(e)
        e = UnitUtils.ConvertToInternalUnits(e,UnitTypeId.Meters)
        l = levels[l]
        elevation = l.get_Parameter(BuiltInParameter.LEVEL_ELEV)
        elevation.Set(e)
        #name.Set('Level %s' % e_name)


for e in elevations[len(levels):]:
        e_name = str(e)
        e = UnitUtils.ConvertToInternalUnits(e,UnitTypeId.Meters)
        l = Level.Create(doc,e).ToDSType(False)
TransactionManager.Instance.TransactionTaskDone()


#After the levels where created, get the levels from the model and set the parameter
collector = FilteredElementCollector(doc)
levels = collector.OfCategory(BuiltInCategory.OST_Levels).ToElements()
levels = levels[1:]

TransactionManager.Instance.EnsureInTransaction(doc)

for l in range(len(levels)):
        e = elevations[l]
        e_name = str(e)
        l = levels[l]
        name = l.get_Parameter(BuiltInParameter.DATUM_TEXT)
        name.Set('Level %s' % e_name)
        
TransactionManager.Instance.TransactionTaskDone()

levels = collector.OfCategory(BuiltInCategory.OST_Levels).ToElements()
levels = levels[1:]





OUT = levels
# ----------------------------------------

# group: Floor Creation
code_block_3 = CodeBlock(output=get_walls_and_floors) { internal_walls = output[0]; external_walls = output[1]; floors = output[2]; }
get_floor_outlines = Python(IN[0]=code_block_3.floors, IN[1]=get_and_create_levels, IN[2]=floor_type)  # CPython3
# ---------- get_floor_outlines.python (60 lines) ----------
# Load the Python Standard and DesignScript Libraries
import sys
import clr
clr.AddReference("System.Core")
import System
clr.ImportExtensions(System.Linq)
from System.Collections.Generic import *
clr.AddReference('ProtoGeometry')
from Autodesk.DesignScript.Geometry import *
clr.AddReference('RevitServices')
import RevitServices
from RevitServices.Persistence import DocumentManager
from RevitServices.Transactions import TransactionManager
clr.AddReference('RevitAPI')
from Autodesk.Revit.DB import *
clr.AddReference ('RevitNodes')
import Revit
clr.ImportExtensions(Revit.Elements)
clr.ImportExtensions(Revit.GeometryConversion)

def get_curves(level,levels_dict_floors):
  """This function takes a level and the dictionary and returns the curves corresponding to that level"""
  name = level.Name
  curves = levels_dict_floors[name]
  if len(curves)>0:
    return curves
  else:
    return None

def convert_nurbs(curve):
    """This function takes a Nurbs Curve and rebuilds it"""
    points = []
    points.append(curve.StartPoint)
    parameters = [0.25,0.5,0.75]
    for p in parameters:
        point= curve.PointAtParameter(p)
        points.append(point)
    points.append(curve.EndPoint)
    curve = NurbsCurve.ByPoints(points)
    return curve

doc = DocumentManager.Instance.CurrentDBDocument
levels_dict_floors = IN[0]
levels = UnwrapElement(IN[1])
floor_type = UnwrapElement(IN[2])
output = []


for level in levels:
        curves = get_curves(level,levels_dict_floors)
        if curves!=None:
            #By joining and retrieving the curves, the new list of curves is ordered to create the floors"""
            polyline = PolyCurve.ByJoinedCurves(curves)
            curves = polyline.Curves()
            for curve in range(len(curves)):
                if isinstance(curves[curve],NurbsCurve):
                    curves[curve] = convert_nurbs(curves[curve])  
            if curves != None:
                output.append([curves,floor_type,level])
OUT = output
# ----------------------------------------
create_floors = CodeBlock(t2=get_floor_outlines)
# ---------- create_floors.designscript (4 lines) ----------
t1 = List.GetItemAtIndex(t2@L3<1>, 0);
t3 = List.GetItemAtIndex(t2@L3<1>, 1);
t4 = List.GetItemAtIndex(t2@L3<1>, 2);
floor1 = Floor.ByOutlineTypeAndLevel(t1, t3, t4);
# ----------------------------------------

# group: Wall Creation
create_walls = Python(IN[0]=code_block_3.internal_walls, IN[1]=code_block_3.external_walls, IN[2]=get_and_create_levels, IN[3]=interior_wall_type, IN[4]=exterior_wall_type, IN[5]=floor_type)  # CPython3
# ---------- create_walls.python (77 lines) ----------
# Load the Python Standard and DesignScript Libraries
import sys
import clr
clr.AddReference("System.Core")
import System
clr.ImportExtensions(System.Linq)
from System.Collections.Generic import Dictionary,List
clr.AddReference('ProtoGeometry')
from Autodesk.DesignScript.Geometry import *
clr.AddReference('RevitServices')
import RevitServices
from RevitServices.Persistence import DocumentManager
from RevitServices.Transactions import TransactionManager
clr.AddReference('RevitAPI')
from Autodesk.Revit.DB import *
clr.AddReference ('RevitNodes')
import Revit
clr.ImportExtensions(Revit.Elements)
clr.ImportExtensions(Revit.GeometryConversion)


def create_walls(dictionary,levels,type,wall_type):
  """Thie function takes the dictionary of the walls, levels, interior or exterior type, and revit wall type and creates the walls, depending on the type of wall to be created"""
  walls = []
  for level in levels:
    curves = dictionary[str(level.Name)]
    for curve in curves:
      if len(curve)>2:
          #create wall by profile
          profile = [p.ToRevitType() for p in curve]
          try:
            new_wall = Wall.Create(doc, profile, wall_type.Id, level.Id,False)
            walls.append(new_wall.ToDSType(False))
          except:
            print("Wall profile not created")
      elif isinstance(curve[0],list):
          profile = [p.ToRevitType() for p in curve[0]]
          normal = curve[1].ToRevitType()
          try:
              new_wall = Wall.Create(doc,profile, wall_type.Id,level.Id,False,normal)
              walls.append(new_wall.ToDSType(False))
          except:
            print("Slanted wall not created")
      
      else:
          height = UnitUtils.ConvertToInternalUnits(float(curve[1]),UnitTypeId.Meters)
          if type == 'Internal':
            height += (-floor_thickness.AsDouble())
          try:
            new_wall = Wall.Create(doc,curve[0].ToRevitType(),wall_type.Id,level.Id,height,0,False,False)
            walls.append(new_wall.ToDSType(False))
          except:
            print("Flat wall could not be created")
  return walls



levels = UnwrapElement(IN[2])
wall_type_internal = UnwrapElement(IN[3])
wall_type_external = UnwrapElement(IN[4])

walls_list = [['Internal',IN[0],wall_type_internal],['External',IN[1],wall_type_external]]

floor_type = UnwrapElement(IN[5])
floor_thickness = floor_type.get_Parameter(BuiltInParameter.FLOOR_ATTR_DEFAULT_THICKNESS_PARAM)
walls = []


doc = DocumentManager.Instance.CurrentDBDocument
TransactionManager.Instance.EnsureInTransaction(doc)

for dictionary in walls_list:
  walls.append(create_walls(dictionary[1],levels,dictionary[0],dictionary[2]))

TransactionManager.Instance.TransactionTaskDone()

OUT = walls
# ----------------------------------------
code_block_4 = CodeBlock(t2=create_walls) { t1 = List.Flatten(t2, -1); t3 = Element.Geometry(t1); t4 = List.Flatten(t3, -1); }

# group: Curved Walls Creation
wall_location = WallLocation("CoreExterior")
categories = Categories("OST_Mass")
code_block_5 = CodeBlock(t2=code_block_2.curvedCells, t3=code_block_2.names_masses, t4=categories, t5=metric_generic_model_file_path, t6=code_block_2.insertion_points)
# ---------- code_block_5.designscript (6 lines) ----------
t1 = t2;
geometry1 = Geometry.Scale(t1<1L>, 0.3048000097536);
material1 = Material.ByName("Default");
familytype1 = FamilyType.ByGeometry(geometry1<1L>, t3<1L>, t4<1L>, t5<1L>, material1<1L>, "");
familyinstance1 = FamilyInstance.ByPoint(familytype1, t6);
surface1 = Element.Faces(familyinstance1);
# ----------------------------------------
select_faces = Python(IN[0]=code_block_5.surface1, IN[1]=code_block_4.t4)  # CPython3
# ---------- select_faces.python (51 lines) ----------
# Load the Python Standard and DesignScript Libraries
import sys
import clr
clr.AddReference("System.Core")
import System
clr.ImportExtensions(System.Linq)
from System.Collections.Generic import Dictionary,List
clr.AddReference('ProtoGeometry')
from Autodesk.DesignScript.Geometry import *
clr.AddReference('RevitServices')
import RevitServices
from RevitServices.Persistence import DocumentManager
from RevitServices.Transactions import TransactionManager
clr.AddReference('RevitAPI')
from Autodesk.Revit.DB import *
clr.AddReference ('RevitNodes')
import Revit
clr.ImportExtensions(Revit.Elements)
clr.ImportExtensions(Revit.GeometryConversion)
import itertools

def find_walls(faces):
    new_faces = []
    for face in range(len(faces)):
        normal = faces[face].NormalAtParameter(0.5,0.5)
        z_vector = abs(normal.Z)
        if 0.3 > z_vector:
            new_faces.append(faces[face])
    return new_faces
def check_wall(face,geometry):
    for geo in range(len(geometry)):
        point = face.PointAtParameter(0.5,0.5)
        distance = geometry[geo].DistanceTo(point)
        if distance < 0.1:
            return True
        

faces = UnwrapElement(IN[0])
faces = list(itertools.chain(*faces))
geometry = IN[1]

faces = find_walls(faces)
output = []
for face in faces:
    if check_wall(face, geometry):
        pass
    else:
        output.append(face)


OUT = output
# ----------------------------------------
byFace = Wall.ByFace(locationLine=wall_location, wallType=exterior_wall_type, surface=select_faces)

# group: Family Creation
create_family_types = Python(IN[0]=code_block_2.apertures, IN[1]=door_family_type, IN[2]=window_family_type)  # CPython3
# ---------- create_family_types.python (149 lines) ----------
# Load the Python Standard and DesignScript Libraries
import sys
import clr
clr.AddReference('ProtoGeometry')
from Autodesk.DesignScript.Geometry import *
clr.AddReference('RevitServices')
import RevitServices
from RevitServices.Persistence import DocumentManager
from RevitServices.Transactions import TransactionManager
clr.AddReference('RevitAPI')
from Autodesk.Revit.DB import *
clr.AddReference ('RevitNodes')
import Revit
clr.ImportExtensions(Revit.Elements)
clr.ImportExtensions(Revit.GeometryConversion)



def type_name(apertures):
    """This function takes the apertures and organizes the parameters for family creation"""
    doors = []
    windows = []
    for aperture in apertures:
        dictionary = aperture.Dictionary
        opening = dictionary['Opening']
        type_name = dictionary['Type Name']
        height = dictionary['Height']
        width = dictionary['Width']
        if opening == 'Door':
            type = {'Height': height,'Width': width, 'Type Name': type_name}
            if type not in doors:
                doors.append(type)
        else:
            type = {'Height': height,'Width': width, 'Type Name': type_name}
            if type not in windows:
                windows.append(type)
    return doors,windows
 
def type_mark(openings):
    for number,value in enumerate(openings):
        openings[number]['Type Mark'] = 'Type ' + str(number + 1)
    return openings
    
def find_names(openings):
    """This function retrieves the name of Family type opening"""
    names = []
    for item in openings:
        names.append(item['Type Name'])
    return names

def copy_famtypes(openings,famtype):
    """This function copies the family type for opening. This is for the next function to work"""
    famtypes = []
    for item in range(len(openings)):
        famtypes.append(famtype)
    return famtypes
    
def create_new_families(doc,famtypes,newnames):
    """Code modified from dimven. “Dimven/SpringNodes.” GitHub, 8 Mar. 2020, github.com/dimven/SpringNodes/blob/2826570c2d0d91f4bd2d84fcf73e267e0bba6155/py/ElementType.Duplicate.py. Accessed 26 May 2021."""
    elementlist = []
    func_enum = {'Revit.Elements.WallType' : Revit.Elements.WallType.ByName,
                         'Revit.Elements.FloorType' : Revit.Elements.FloorType.ByName,
                         'Revit.Elements.FamilyType' : Revit.Elements.FamilyType.ByName}
    TransactionManager.Instance.EnsureInTransaction(doc)
    for i in range(len(famtypes) ):
            try:
                    elementlist.append(UnwrapElement(famtypes[i]).Duplicate(newnames[i]) )
            except:
                    try:
                            t1 = famtypes[i].GetType().ToString()
                            if t1 in func_enum:
                                    elementlist.append(func_enum[t1](newnames[i]) )
                            else:
                                    elementlist.append(None)
                    except:
                            elementlist.append(None)

    TransactionManager.Instance.TransactionTaskDone()
    """End of code from dimven. “Dimven/SpringNodes.” GitHub, 8 Mar. 2020, github.com/dimven/SpringNodes/blob/2826570c2d0d91f4bd2d84fcf73e267e0bba6155/py/ElementType.Duplicate.py. Accessed 26 May 2021."""
    return elementlist


#def change_parameters(family,parameters):
#   """Code modified from dannysbentley 2021. dannysbentley/pyDynamo. Available at: https://github.com/dannysbentley/pyDynamo/blob/master/ParameterSet.py [Accessed: 27 May 2021]."""
    

def get_types(type , names):
    """This function gets the list of family names from the project"""
    types = FilteredElementCollector(doc).WherePasses(FamilySymbolFilter(type.Family.Id)).ToElements()
    output = []
    for type in types:
        name = type.get_Parameter(BuiltInParameter.SYMBOL_NAME_PARAM).AsString()
        if name in names:
            output.append(type)
    return output
    
def change_parameters(famtypes, parameters, dictionaries):
    """This function gets the parameters and sets the parameters to the family type"""
    for fam in famtypes:
        name = fam.get_Parameter(BuiltInParameter.SYMBOL_NAME_PARAM).AsString()
        values = []
        for item in dictionaries:
            if item['Type Name'] == name:
                height = item['Height']
                width = item['Width']
                typemark = item['Type Mark']
                values = [height,width,typemark]
        for parameter in range(len(parameters)):
            value = UnitUtils.ConvertToInternalUnits(float(values[parameter]), UnitTypeId.Meters)
            parameter = fam.get_Parameter(parameters[parameter])
            parameter.Set(value)


uiapp = DocumentManager.Instance.CurrentUIApplication
app = uiapp.Application

doc = DocumentManager.Instance.CurrentDBDocument
apertures = IN[0]
door_type = UnwrapElement(IN[1])
window_type = UnwrapElement(IN[2])

#Create dictionary with all the information to create the new families
doors = type_mark(type_name(apertures)[0])
windows = type_mark(type_name(apertures)[1])

#Extract the names of the new families to be created
door_names = find_names(doors)
window_names = find_names(windows)

#In order for the 'create_new_families' 
doortypes = copy_famtypes(door_names,door_type)
windowtypes = copy_famtypes(window_names,window_type)


#Create all of the families and the sizes
new_doors = create_new_families(doc,doortypes,door_names)
new_windows = create_new_families(doc,windowtypes,window_names)

#After creating get all the new family types created. If the families were already created, then the new_families would be empty, so it is better to get the family types again with their names
door_types = get_types(door_type,door_names)
window_types = get_types(window_type, window_names)

#Now we need to change the family parameters to match the sizes in the model
door_parameters = [BuiltInParameter.DOOR_HEIGHT,BuiltInParameter.DOOR_WIDTH]
window_parameters = [BuiltInParameter.WINDOW_HEIGHT,BuiltInParameter.WINDOW_WIDTH]

change_parameters(door_types, door_parameters, doors)
change_parameters(window_types, window_parameters, windows)
OUT = door_types,window_types
# ----------------------------------------
code_block_6 = CodeBlock(OUT=create_family_types) { door_types =OUT[0]; window_types = OUT[1]; }
windows_and_doors = Python(IN[0]=code_block_4.t1, IN[1]=code_block_2.apertures, IN[2]=code_block_4.t4, IN[3]=code_block_6.door_types, IN[4]=code_block_6.window_types)  # CPython3
# ---------- windows_and_doors.python (94 lines) ----------
# Load the Python Standard and DesignScript Libraries
import sys
import clr
clr.AddReference('ProtoGeometry')
from Autodesk.DesignScript.Geometry import *
clr.AddReference('RevitServices')
import RevitServices
from RevitServices.Persistence import DocumentManager
from RevitServices.Transactions import TransactionManager
clr.AddReference('RevitAPI')
from Autodesk.Revit.DB import *
clr.AddReference ('RevitNodes')
import Revit
import Autodesk
clr.ImportExtensions(Revit.Elements)
clr.ImportExtensions(Revit.GeometryConversion)

def find_wall(point,geometry):
    """This function receives the insert point of the aperture and searches the closest wall to host it"""
    for geo in range(len(geometry)):
        distance = geometry[geo].DistanceTo(point)
        if distance < 0.01:
            return geo
def find_type(type_name, famtypes):
    """This function searches for the corresponding family type from the opening type_name"""
    for fam in famtypes:
        name = fam.get_Parameter(BuiltInParameter.SYMBOL_NAME_PARAM).AsString()
        if name == type_name:
            return fam

uiapp = DocumentManager.Instance.CurrentUIApplication
app = uiapp.Application
doc = DocumentManager.Instance.CurrentDBDocument
# The inputs to this node will be stored as a list in the IN variables.
walls = UnwrapElement(IN[0])
apertures = IN[1]
dictionaries = IN[2]
geometry = IN[2]
door_types = UnwrapElement(IN[3])
window_types = UnwrapElement(IN[4])
output = []

aperture_dict = apertures[0].Dictionary


host = []
ftype = []
fpts = []

for aperture in apertures:
    point = aperture.Contents[0].Geometry
    geo = find_wall(point,geometry)
    if geo == None:
        geo = 0
    dictionary = aperture.Dictionary
    number = float(dictionary['Number'])
    opening = dictionary['Opening']
    type_name = dictionary['Type Name']
    if opening == 'Door':
        family = find_type(type_name,door_types)
    else:
        family = find_type(type_name,window_types)
    host.append(walls[geo])
    ftype.append(family)
    fpts.append(point)

""" The following code was adapted from ---. “Dimven/SpringNodes.” GitHub, 22 July 2020, github.com/dimven/SpringNodes. Accessed 31 May 2021."""

#Copyright(c) 2016, Dimitar Venkov
# @5devene, dimitar.ven@gmail.com


output = []
strt = Autodesk.Revit.DB.Structure.StructuralType.NonStructural
ftp_len = len(ftype) == 1
hst_len = len(host) == 1

TransactionManager.Instance.EnsureInTransaction(doc)
for i in range(len(fpts) ):
	p = fpts[i].ToXyz(True)
	j = 0 if ftp_len else i
	k = 0 if hst_len else i
	try:
		if not ftype[j].IsActive : ftype[j].Activate()
		level = doc.GetElement(host[k].LevelId)
		nf = doc.Create.NewFamilyInstance(p,ftype[j],host[k],level,strt)
		output.append(nf.ToDSType(False))
	except:
		output.append(None)
TransactionManager.Instance.TransactionTaskDone()

"""End of code from Dimitar Venkov"""

OUT = output
# ----------------------------------------
